vi "Function_2.gviweb"   [LabVIEW NXG 3.0.0]
panel controls:
  "Details Control": string = "Function_3.html"
panel indicators:
  "Injection Image": string
  "Shutter Image": string
  "Valve Image": string
  "Pressure Image": string
  "Hutch Image": string
  "Flow Rate Image": string
  "Temp Image": string
  "Beam Current": f64
  "Liquid Nitrogen Mode": f64
  "Injection": string
  "XAS Scan Status": string
  "XAS Scan Mode": string
  "shutter": bool
  "valve": bool
  "pressure": bool
  "hutch": bool
  "flow rate": bool
  "temp": bool
  "Status img": string
  "danger img": string
  "Scanning img": string
  "nitrogrn img": string
  "Beam Image": string
  "auto fill": bool
types:
  T1 = cluster{"Alarm Valve Status": bool, "Alarm Pressure": bool, "Alarm Hutch Status": bool, "Flow error status": bool, "Temp error status": bool, "DSS-B1 Status Open": bool, "LNi auto fill": bool, "XAS scan status": bool, "Injection Status": i32, "XAS Mode": i32, "Beam Current": f64, "LNi level": f64}
uses:
  NI::HTTP::GET.gvi
diagram:
  while {
    call "GET.gvi"(url="http://127.0.0.1:8080/BL11WebService/MainPage") -> (body=w1)
    Unflatten From JSON(JSON string=w1, type and defaults=T1 {all zero or empty}) -> (value=w2)
    Property Node(instance in=w2) -> ("Alarm Valve Status"=w3, "Alarm Pressure"=w4, "Alarm Hutch Status"=w5, "Flow error status"=w6, "Temp error status"=w7, "DSS-B1 Status Open"=w8, "LNi auto fill"=w9, "XAS scan status"=w10, "Injection Status"=w11, "XAS Mode"=w12, "Beam Current"=w13, "LNi level"=w14)
    case (w10) {
      frame False, Default {
        w15 = "Stopped"
      }
      frame True {
        w15 = "Scanning"
      }
    }
    $"XAS Scan Status" <- w15
    $valve <- w3
    $pressure <- w4
    case (w11) {
      frame 0, Default {
        w16 = ""
      }
      frame 1 {
        w16 = "No Beam"
      }
      frame 2 {
        w16 = "Injection"
      }
      frame 3 {
        w16 = "Beam Stored"
      }
      frame 4 {
        w16 = "Ramping"
      }
    }
    $Injection <- w16
    $hutch <- w5
    $"flow rate" <- w6
    $temp <- w7
    $shutter <- w8
    $"auto fill" <- w9
    case (w12) {
      frame 0, Default {
        w17 = ""
      }
      frame 1 {
        w17 = "Transmission"
      }
      frame 2 {
        w17 = "Florescence"
      }
      frame 3 {
        w17 = "Combination"
      }
    }
    $"XAS Scan Mode" <- w17
    $"Beam Current" <- w13
    $"Liquid Nitrogen Mode" <- w14
    Wait(time to wait=50)
    stop if TRUE
  }
