vi "Function_3.gviweb"   [LabVIEW NXG 3.0.0]
panel controls:
  "Main Control": string = "Function_2.html"
  "Home Image": string = "Image/home.png"
panel indicators:
  "Percent Complete": f64
  "FL Dead Time": f64
  "Status": string
  "Mode": string
  "File Name": string
  "Queue Name": string
  "Current Energy": f64
  "error message": string
  "Current Amp Status": bool
  "NAS Connection": bool
  "Macro Mode": bool
  "energy mode": string
  "In(I0/I1)": f64
  "In(I1/I2)": f64
  "In(if/I0)": f64
  "I0": u32
  "I1": u32
  "I2": u32
  "If": u32
  "E0": f64
  "Emin": f64
  "Emax": f64
  "start time": string
  "finish time": string
  "current queue": string
  "current scan": string
  "continue switch": bool
types:
  T1 = cluster{"XAS Status": bool, "Current Amp Status": bool, "NAS Connection": bool, "Macro Mode": bool, "XAS Mode": i32, "Energy Mode": i32, "Current Queue": u8, "Current Scan": u8, "Number of Queue": u8, "Number of Scan": u8, "I0": u32, "I1": u32, "I2": u32, "If": u32, "Fl Dead Time": f64, "E0": f64, "Emin": f64, "Emax": f64, "Percent Complete": f64, "Current Energy": f64, "In(I0/I1)": f64, "In(I1/I2)": f64, "If/I0": f64, "File Name": string, "Queue Name": string, "Error Message": string, "Start": string, "Finish": string}
uses:
  NI::HTTP::GET.gvi
diagram:
  while {
    call "GET.gvi"(url="http://127.0.0.1:8080/BL11WebService/XASPage") -> (body=w1)
    w2 = T1 {"NAS Connection"=TRUE, "Macro Mode"=TRUE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}
    Unflatten From JSON(JSON string=w1, type and defaults=w2) -> (value=w3)
    Property Node(instance in=w3) -> ("XAS Status"=w4, "Current Amp Status"=w5, "NAS Connection"=w6, "Macro Mode"=w7, "XAS Mode"=w8, "Energy Mode"=w9, "Current Queue"=w10, "Number of Queue"=w11, "Current Scan"=w12, "Number of Scan"=w13, "I0"=w14, "I1"=w15, "I2"=w16, "If"=w17, "Fl Dead Time"=w18, "E0"=w19, "Emin"=w20, "Emax"=w21, "Percent Complete"=w22, "Current Energy"=w23, "In(I0/I1)"=w24, "In(I1/I2)"=w25, "If/I0"=w26, "File Name"=w27, "Queue Name"=w28, "Error Message"=w29, "Start"=w30, "Finish"=w31)
    case (w4) {
      frame False, Default {
        w32 = "Stopped"
      }
      frame True {
        w32 = "Scanning"
      }
    }
    $Status <- w32
    $"Current Amp Status" <- w5
    $"NAS Connection" <- w6
    $"Macro Mode" <- w7
    case (w8) {
      frame 0, Default {
        w33 = ""
      }
      frame 1 {
        w33 = "Transmission"
      }
      frame 2 {
        w33 = "Fluorescence"
      }
      frame 3 {
        w33 = "Combination"
      }
    }
    $Mode <- w33
    $I0 <- w14
    $I1 <- w15
    $I2 <- w16
    case (w9) {
      frame 0, Default {
        w34 = ""
      }
      frame 1 {
        w34 = "Absolute"
      }
      frame 2 {
        w34 = "Relative"
      }
    }
    $"energy mode" <- w34
    $If <- w17
    $"FL Dead Time" <- w18
    $E0 <- w19
    $Emin <- w20
    $Emax <- w21
    Number To Decimal String(number=w10) -> (decimal integer string=w35)
    Number To Decimal String(number=w11) -> (decimal integer string=w36)
    Concatenate Strings(w35, "/", w36) -> w37
    $"current queue" <- w37
    $"Percent Complete" <- w22
    $"Current Energy" <- w23
    $"In(I0/I1)" <- w24
    $"In(I1/I2)" <- w25
    $"In(if/I0)" <- w26
    $"File Name" <- w27
    $"Queue Name" <- w28
    Number To Decimal String(number=w12) -> (decimal integer string=w38)
    Number To Decimal String(number=w13) -> (decimal integer string=w39)
    Concatenate Strings(w38, "/", w39) -> w40
    $"current scan" <- w40
    $"error message" <- w29
    $"start time" <- w30
    Wait(time to wait=50)
    $"finish time" <- w31
    stop if TRUE
  }
