vi "Function_4.gviweb"   [LabVIEW NXG 3.0.0]
panel controls:
  "Main Control": string = "Main.html"
  "home2 Control": string = "Main.html"
panel indicators:
  "Home1_Image": string
  "XAS Status": string
  "XAS Mode": string
  "Current Amp": bool
  "FL Dead Time": f64
  "NAS Conection": bool
  "Macro": bool
  "E0": f64
  "Emin": f64
  "Emax": f64
  "time image": string
  "percent complete": f64
  "percent number": string
  "file name": string
  "queue name": string
  "current energy": f64
  "in(i0/i1)": f64
  "in(i1/i2)": f64
  "in(i2/i0)": f64
  "i0": u32
  "i1": u32
  "i2": u32
  "if": u32
  "Error Message": string
  "home2 Image": string
  "energy": string
  "start time": string
  "finish time": string
  "cerrent queue": string
  "current scan": string
  "continue switch": bool
types:
  T1 = cluster{"XAS Status": bool, "Current Amp Status": bool, "NAS Connection": bool, "Macro Mode": bool, "XAS Mode": i32, "Energy Mode": i32, "Current Queue": u8, "Current Scan": u8, "Number of Queue": u8, "Number of Scan": u8, "I0": u32, "I1": u32, "I2": u32, "If": u32, "Fl Dead Time": f64, "E0": f64, "Emin": f64, "Emax": f64, "Percent Complete": f64, "Currente Energy": f64, "In(I0/I1)": f64, "In(I1/I2)": f64, "If/I0": f64, "File Name": string, "Queue Name": string, "Error Message": string, "Start": string, "Finish": string}
uses:
  NI::HTTP::GET.gvi
diagram:
  while {
    call "GET.gvi"(url="http://127.0.0.1:8080/BL11WebService/XASPage") -> (body=w1)
    w2 = T1 {"NAS Connection"=TRUE, "Macro Mode"=TRUE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}
    Unflatten From JSON(JSON string=w1, type and defaults=w2) -> (value=w3)
    Property Node(instance in=w3) -> ("XAS Status"=w4, "Current Amp Status"=w5, "NAS Connection"=w6, "Macro Mode"=w7, "XAS Mode"=w8, "Energy Mode"=w9, "Current Queue"=w10, "Number of Queue"=w11, "Current Scan"=w12, "Number of Scan"=w13, "I0"=w14, "I1"=w15, "I2"=w16, "If"=w17, "Fl Dead Time"=w18, "E0"=w19, "Emin"=w20, "Emax"=w21, "Percent Complete"=w22, "Currente Energy"=w23, "In(I0/I1)"=w24, "In(I1/I2)"=w25, "If/I0"=w26, "File Name"=w27, "Queue Name"=w28, "Error Message"=w29, "Start"=w30, "Finish"=w31)
    case (w4) {
      frame False, Default {
        w32 = "Stopped"
      }
      frame True {
        w32 = "Scanning"
      }
    }
    $"XAS Status" <- w32
    $"Current Amp" <- w5
    $"NAS Conection" <- w6
    $Macro <- w7
    case (w8) {
      frame 0, Default {
        w33 = "Tranmission"
      }
      frame 1 {
        w33 = "Transmission"
      }
      frame 2 {
        w33 = "Fluorescence"
      }
      frame 3 {
        w33 = "Combination"
      }
    }
    $"XAS Mode" <- w33
    $i0 <- w14
    $i1 <- w15
    $i2 <- w16
    case (w9) {
      frame 0, Default {
        w34 = ""
      }
      frame 1 {
        w34 = "Absolute"
      }
      frame 2 {
        w34 = "Relative"
      }
    }
    $energy <- w34
    $if <- w17
    $"FL Dead Time" <- w18
    $E0 <- w19
    $Emin <- w20
    $Emax <- w21
    Number To Decimal String(number=w10) -> (decimal integer string=w35)
    Number To Decimal String(number=w11) -> (decimal integer string=w36)
    Concatenate Strings(w35, "/", w36) -> w37
    $"cerrent queue" <- w37
    $"percent complete" <- w22
    $"current energy" <- w23
    $"in(i0/i1)" <- w24
    $"in(i1/i2)" <- w25
    $"in(i2/i0)" <- w26
    $"file name" <- w27
    Number To Decimal String(number=w12) -> (decimal integer string=w38)
    Number To Decimal String(number=w13) -> (decimal integer string=w39)
    Concatenate Strings(w38, "/", w39) -> w40
    $"current scan" <- w40
    $"queue name" <- w28
    $"Error Message" <- w29
    $"start time" <- w30
    $"finish time" <- w31
    Wait(time to wait=50)
    To Byte Integer(number=w22) -> w41
    Number To Decimal String(number=w41) -> (decimal integer string=w42)
    Concatenate Strings(w42, "%") -> w43
    $"percent number" <- w43
    stop if TRUE
  }
