vi "Main.gviweb"   [LabVIEW NXG 3.0.0]
panel controls:
  "Details Control": string = "Function_4.html"
panel indicators:
  "Beam Current": f64
  "Shutter": bool
  "Valve": bool
  "Pressure": bool
  "Hutch": bool
  "Flow Rate": bool
  "Temperature": bool
  "Auto Fill": bool
  "LN2 Level": f64
  "Injection Status": string
  "Injection Image": string
  "XAS Status": string
  "XAS Mode": string
  "status image": string
  "temp image": string
  "XAS Scan image": string
  "flow image": string
  "hutch image": string
  "pressure image": string
  "valve image": string
  "shutter image": string
  "Beam Image": string
  "Danger Image": string
  "Chem Image": string
types:
  T1 = cluster{"Valve Status": bool, "Pressure Status": bool, "Hutch Status": bool, "Flow Rate Status": bool, "Temperature Status": bool, "BL1.1W Shutter": bool, "Auto Fill Status": bool, "XAS Status": bool, "Injection Status": i32, "XAS Mode": i32, "Beam Current": f64, "LN2 Level": f64}
uses:
  NI::HTTP::Open HTTP Handle.gvi
  NI::HTTP::GET.gvi
  NI::HTTP::Close HTTP Handle.gvi
diagram:
  call "Open HTTP Handle.gvi"() -> (client handle out=w1, error out=w2)
  s1 = w1  # shift register
  s2 = w2  # shift register
  while {
    call "GET.gvi"(client handle=s1, url="http://127.0.0.1:8080/BL11WebService/MainPage", error in=s2) -> (client handle out=w3, body=w4, error out=w5)
    Unflatten From JSON(JSON string=w4, type and defaults=T1 {all zero or empty}) -> (value=w6)
    Property Node(instance in=w6) -> ("Valve Status"=w7, "Pressure Status"=w8, "Hutch Status"=w9, "Flow Rate Status"=w10, "Temperature Status"=w11, "BL1.1W Shutter"=w12, "Auto Fill Status"=w13, "XAS Status"=w14, "Injection Status"=w15, "XAS Mode"=w16, "Beam Current"=w17, "LN2 Level"=w18)
    case (w14) {
      frame False, Default {
        w19 = "Stopped"
      }
      frame True {
        w19 = "Scanning"
      }
    }
    $"XAS Status" <- w19
    $Valve <- w7
    $Pressure <- w8
    case (w15) {
      frame 0, Default {
        w20 = ""
      }
      frame 1 {
        w20 = "No Beam"
      }
      frame 2 {
        w20 = "Injection"
      }
      frame 3 {
        w20 = "Beam Stored"
      }
      frame 4 {
        w20 = "Ramping"
      }
    }
    $"Injection Status" <- w20
    $Hutch <- w9
    $"Flow Rate" <- w10
    $Temperature <- w11
    $Shutter <- w12
    $"Auto Fill" <- w13
    case (w16) {
      frame 0, Default {
        w21 = ""
      }
      frame 1 {
        w21 = "Transmission"
      }
      frame 2 {
        w21 = "Fluorescence"
      }
      frame 3 {
        w21 = "Combination"
      }
    }
    $"XAS Mode" <- w21
    $"Beam Current" <- w17
    $"LN2 Level" <- w18
    Wait(time to wait=5000)
    next s1 = w3
    next s2 = w5
    stop if TRUE
  }
  call "Close HTTP Handle.gvi"(client handle=s1, error in=s2)
